% Simulink data dictionary Data.sldd

InBus = Simulink.Bus()
  a: double
  a1: double
  a2: double

OutBus = Simulink.Bus()
  a: double
  a1: double
  a2: double

Params = Simulink.Bus()
  p: double
  p1: double
  p2: double

PlantOut = Simulink.Bus()
  a_p: double
  a1_p: double
  a2_p: double

PlantIn = Simulink.Bus()
  a_p: double
  a1_p: double
  a2_p: double

ExtParams = Simulink.Bus()
  p_ext: double
  p1_ext: double
  p2_ext: double